# Grasshopper definition 2 Background Map.gh (Grasshopper 1.0.7)
# plug-ins: Heron

# ---- group: Boundary Curve
# SET ANCHOR POINT
# DO BACKGROUND IMAGE
geo = Geometry(<curve referenced from the Rhino model>)

# ---- group: USGS Raster Maps
usgs = ValueList({"Ortho 1 Foot Imagery": "http://raster.nationalmap.gov/arcgis/rest/services/Orthoimagery/USGS_EROS_Ortho_1Foot/ImageServer/exportImage?", "Ortho Imagery": "http://raster.nationalmap.gov/arcgis/rest/services/Orthoimagery/USGS_EROS_Ortho/ImageServer/exportImage?", "NAIP Imagery": "http://raster.nationalmap.gov/arcgis/rest/services/Orthoimagery/USGS_EROS_Ortho_NAIP/ImageServer/exportImage?", "Land Cover": "http://raster.nationalmap.gov/arcgis/rest/services/LandCover/USGS_EROS_LandCover_NLCD/MapServer/export?", "Land Cover - Conus 01": "http://raster.nationalmap.gov/arcgis/rest/services/LandCover/conus_01/MapServer/export?", "Land Cover - Conus 06": "http://raster.nationalmap.gov/arcgis/rest/services/LandCover/conus_06/MapServer/export?", "Land Cover - Development": "http://raster.nationalmap.gov/arcgis/rest/services/LandCover/Development_0106/MapServer/export?", "Land Cover - Wetland": "http://raster.nationalmap.gov/arcgis/rest/services/LandCover/Wetland_0106/MapServer/export?", "Topo - Scanned Maps": "http://raster.nationalmap.gov/arcgis/rest/services/Scanned_Maps/USGS_EROS_DRG_SCALE/ImageServer/exportImage?"}, selected="Ortho 1 Foot Imagery")

# ---- group: Not all imagery available at each resolution
resolution = ValueList({"None": , "Low": 256, "Med": 512, "High": 1024, "Max": 2048}, selected="Max")

# ---- group: Catalog of ESRI ArcGIS REST Basemaps
esri_arcgis_base_maps = ValueList({"World Imagery": "http://server.arcgisonline.com/ArcGIS/rest/services/World_Imagery/MapServer/export?", "World Topographic": "http://server.arcgisonline.com/ArcGIS/rest/services/World_Topo_Map/MapServer/export?", "World Physical Map": "http://server.arcgisonline.com/ArcGIS/rest/services/World_Physical_Map/MapServer/export?", "World Street Map": "http://server.arcgisonline.com/ArcGIS/rest/services/World_Street_Map/MapServer/export?", "World DeLorme Street Map": "http://server.arcgisonline.com/ArcGIS/rest/services/Specialty/DeLorme_World_Base_Map/MapServer/export?", "World Shaded Relief": "http://server.arcgisonline.com/ArcGIS/rest/services/World_Shaded_Relief/MapServer/export?", "World Terrain Base": "http://server.arcgisonline.com/ArcGIS/rest/services/World_Terrain_Base/MapServer/export?", "World Boundaries and Places": "http://server.arcgisonline.com/ArcGIS/rest/services/Reference/World_Boundaries_and_Places/MapServer/export?", "World Boundaries and Places Alt": "http://server.arcgisonline.com/ArcGIS/rest/services/Reference/World_Boundaries_and_Places_Alternate/MapServer/export?", "World Reference Overlay": "http://server.arcgisonline.com/ArcGIS/rest/services/Reference/World_Reference_Overlay/MapServer/export?", "World Transportation": "http://server.arcgisonline.com/ArcGIS/rest/services/Reference/World_Transportation/MapServer/export?", "World Light Gray Base": "http://server.arcgisonline.com/ArcGIS/rest/services/Canvas/World_Light_Gray_Base/MapServer/export?", "World Light Gray Reference": "http://server.arcgisonline.com/ArcGIS/rest/services/Canvas/World_Light_Gray_Reference/MapServer/export?", "National Geographic World": "http://services.arcgisonline.com/ArcGIS/rest/services/NatGeo_World_Map/MapServer/export?", "USA Topo Maps": "http://server.arcgisonline.com/ArcGIS/rest/services/USA_Topo_Maps/MapServer/export?"}, selected="World Imagery")

# ----
image_prefix = Panel("aerial")
folder_location_for_images = Panel("C:\Users\vince\Dropbox\UCL RC15 Skills 2024\WIP Folder\Extra Maps in Grasshopper\map")
restraster = GetRESTRaster(
    Boundary=geo,
    Resolution=resolution,
    TargetFolder=folder_location_for_images,
    Prefix=image_prefix,
    RESTURL=esri_arcgis_base_maps,
    ImageType="jpg",
    Run=Toggle(True))  # -> Image, ImageFrame, RESTQuery
panel = Panel(esri_arcgis_base_maps)

# ----
# The earth anchor point has to be set in any case.
# The 0,0,0 point of Rhino has to be set to a real world coordinate.
# You can get the point by searching for it. Or you simply look up a place in google maps, copy/paste the cooridantes and plug them into the "SetEAP" component.
lat = Panel("51.512297")
long = Panel("-0.121123")
seteap = SetEarthAnchorPoint(SetEAP=Toggle(True), Latitude=lat, Longitude=long)
