# Grasshopper definition 3 Export to Illustrator.gh (Grasshopper 1.0.7)
# plug-ins: EleFront

value_list = ValueList({"2022", "2023", "2024"}, selected="2024")
reference_by_user_atributes = ReferenceByUserAtributes(Key="\tYear", Val="2023")
xy_plane = XYPlane(Origin=reference_by_user_atributes)
concatenate = Concatenate(FragmentA="Year ", FragmentB="2023")
circle = Circle(Plane=xy_plane, Radius="1")
define_object_attributes = DefineObjectAttributes(Layer=concatenate)
bake_objects = BakeObjects(Geometry=circle, Attributes=define_object_attributes, Bake=False)
