# Grasshopper definition 4 Extra Wurman Dots.gh (Grasshopper 1.0.7)
# plug-ins: EleFront

reference_by_user_atributes = ReferenceByUserAtributes(Key="Year", Val="2024")
geo = Geometry(<point referenced from the Rhino model>)

# ---- group: Input
geo_2 = Geometry(reference_by_user_atributes)
x = Panel("8")
y = Panel("8")

# ---- group: Inclusion
sqgrid = Square(Plane=geo, Size="100", ExtentX=x, ExtentY=y)  # -> flatten(Cells), Points
area = Area(Geometry=sqgrid.Cells)  # -> Area, Centroid
merge = Merge(Data1=geo_2, Data2=area.Centroid)
pt = Point(merge)
incurves = PointInCurves(Point=pt, Curves=sqgrid.Cells)  # -> Relationship, Index, Point
python = GhPythonScript(numbers=incurves.Index)  # -> out, simplify(a); inputs numbers: list of Int32
# ---------- python: Python ----------
import ghpythonlib.treehelpers as th

index_dict = {}
for index, number in enumerate(numbers):
    if number not in index_dict:
        index_dict[number] = []
    index_dict[number].append(index)

# Ensure all numbers from 0 to max(numbers) are included
max_number = max(numbers)
sorted_index_lists = [index_dict.get(i, []) for i in range(max_number + 1)]

from pprint import pprint
pprint(sorted_index_lists)
pprint(index_dict)





a = th.list_to_tree(sorted_index_lists)
# ---------- end python ----------
tstat = TreeStatistics(Tree=python.a)  # -> Paths, Length, Count

# ----
remap_numbers = RemapNumbers(Value=tstat.Length, Source="1 To 200", Target="0 To 1")  # -> Mapped, Clipped
graph_mapper = GraphMapper(
    remap_numbers.Mapped,
    x0=0,
    x1=1,
    y0=0,
    y1=1,
    container_name="Bezier",
    cpx=[0, 0, 0.6136686802, 1],
    cpy=[0, 0.4898912907, 0.9864267111, 1])
xy_plane = XYPlane(Origin=area.Centroid)
multiplication = Multiplication(A=Slider(52, range=0..500), B=graph_mapper)
circle = Circle(Plane=xy_plane, Radius=multiplication)
