# Grasshopper definition ReadArduino.gh (Grasshopper 1.0.7)
# plug-ins: Firefly.Core

ports_available = COMPortsAvailable()
trigger = Trigger(Interval=200, TimerInterval=200, Target=read)
panel = Panel(ports_available)
open_port = OpenClosePort(OpenClosePort=Toggle(True), PortNumber="11", BaudRate="115200")
read = SerialReadGeneric(StartReadingValues=Toggle(True), PortNumber="11")  # -> SerialOutput, StatusMessage
# THIS DOESN'T WORK WITH ALL THE BOARDS.
panel_2 = Panel(open_port)
panel_3 = Panel(read.StatusMessage)
panel_4 = Panel(read.SerialOutput)
