# Grasshopper definition 1 OSC Send and Recieve.gh (Grasshopper 1.0.7)
# plug-ins: Firefly.X, gHowl

netsource = NetworkSource()  # -> NetworkAdapterIsUp, AdapterProperties, LocalIpAddress
panel = Panel("How are you?")  # disabled
# Destination IP
netsource_2 = NetworkSource()  # -> NetworkAdapterIsUp, AdapterProperties, LocalIpAddress; disabled
trigger = Trigger(Interval=100, TimerInterval=100, Target=osc_sender)  # disabled
# The IP of your computer
panel_2 = Panel(netsource.LocalIpAddress)
panel_3 = Panel("8000")  # disabled
osc_sender = OSCSender(Data=panel, IPAddressOfUDPServer=netsource_2.LocalIpAddress, UDPPort=panel_3)  # disabled
trigger_2 = Trigger(Interval=100, TimerInterval=100, Target=osc_listener)
udp = UDPReceiver(Address=panel_2, Port="8000", Pattern=0)  # -> Info, Data
panel_4 = Panel(udp.Data)
osc_listener = OSCListener(Port="8000", Reset=Button())
panel_5 = Panel(osc_listener)
