# Grasshopper definition 2 Arduino to Grasshopper OSC.gh (Grasshopper 1.0.7)
# plug-ins: gHowl

netsource = NetworkSource()  # -> NetworkAdapterIsUp, AdapterProperties, LocalIpAddress
panel = Panel(netsource.LocalIpAddress)
udp = UDPReceiver(Address=panel, Port="8000", Pattern="0")  # -> Info, Data
panel_2 = Panel(udp.Data)
rec = DataRecorder(udp.Data, DataLimit=-10, RecordData=False)
panel_3 = Panel(rec)
