# Grasshopper definition 3 OSC Iphone to Grasshopper.ghx (Grasshopper 1.0.7)
# plug-ins: gHowl, Firefly.X

# ----
# OSC with Firefly Plug In
trigger = Trigger(Interval=100, TimerInterval=100, Target=osc_listener)  # disabled
panel = Panel("8000")  # disabled
# The OSC sender needs to know the destination for the message, which in this case is your computer. To find your local IP address, open the Windows search field and type "cmd." The command line app will appear, and then you can type "ipconfig" and press Enter.
button = Button()  # disabled
osc_listener = OSCListener(Port=panel, Reset=button)  # disabled
# < This or This >
# ... but not both...
panel_2 = Panel(osc_listener)  # disabled

# ----
# OSC with Firefly Plug In
netsource = NetworkSource()  # -> NetworkAdapterIsUp, AdapterProperties, LocalIpAddress
# OSC is a protocoll that sits on top of UDP. It's a simplified version. Here we use the components of gHowl. But both are doing the same.
panel_3 = Panel("""/data/location/latitude
/data/location/longitude
/data/location/altitude""")
local_ip_adress_of_your_computer = Panel(netsource.LocalIpAddress)
send_pattern_osc = Panel("999")
port = Panel("8000")
udp = UDPReceiver(Address=netsource.LocalIpAddress, Port=port, Pattern=send_pattern_osc)  # -> Info, Data
message = Panel([udp.Info, udp.Data])
osc_d = OSCDispatch(OSCDevices=panel_3, OSCMessage=udp.Data)  # -> OSCDevice, OSCData
osc_data = Panel(osc_d.OSCData)

item = ListItem(List=osc_d.OSCData, Index=0, Wrap=True)  # -> Item, Item1
concat = Concatenate(FragmentA="https://www.google.com/maps/@", FragmentB=item.Item, FragmentC=",", FragmentD=item.Item1, FragmentE=",18z")
copy_paste_this_into_your_browser = Panel(concat)
