# Grasshopper definition 1 Reading FIles.gh (Grasshopper 1.0.7)

path = FilePath("C:\Users\vince\Dropbox\UCL RC15 Skills 2024\PervasiveUrbanism_24-25\Skills 1 - Day 3 Datavis\3. Importing Text Files\004RC16S.CSV")
file = ReadFile(File=path, PerLineParse=True)
panel = Panel(file)
cull_i = CullIndex(List=file, Indices="0", Wrap=True)
tab = Panel("\t")
split = TextSplit(Text=cull_i, Separators=tab)
panel_2 = Panel(split)
item = ListItem(List=split, Index="3", Wrap=True)  # -> Item, Item1
pt = ConstructPoint(XCoordinate=item.Item1, YCoordinate=item.Item, ZCoordinate=0)

flatten = FlattenTree(Tree=pt, Path="{0}")
item_2 = ListItem(List=flatten, Index=0, Wrap=True)
rev = Reverse(Vector=item_2)
move = Move(Geometry=flatten, Motion=rev)  # -> Geometry, Transform
scale = Scale(Geometry=move.Geometry, Center=Point(0, 0, 0), Factor=Slider(10, range=0..10))  # -> Geometry, Transform
