# Grasshopper definition 2 Display Coordinates.gh (Grasshopper 1.0.7)
# plug-ins: Heron, EleFront

# ----
# READ FILE
path = FilePath("C:\Users\vince\Dropbox\UCL RC15 Skills 2024\PervasiveUrbanism_24-25\Skills 1 - Day 3 Datavis\3. Importing Text Files\004RC16S.CSV")
file = ReadFile(File=path, PerLineParse=True)
panel = Panel(file)
cull_i = CullIndex(List=file, Indices="0", Wrap=True)
tab = Panel("\t")
split = TextSplit(Text=cull_i, Separators=tab)
panel_2 = Panel(split)
item = ListItem(List=split, Index="3", Wrap=True)  # -> Item, Item1

# ----
# SET ANCHOR POINT
# The earth anchor point has to be set in any case.
# The 0,0,0 point of Rhino has to be set to a real world coordinate.
# You can get the point by searching for it. Or you simply look up a place in google maps, copy/paste the cooridantes and plug them into the "SetEAP" component.
panel_3 = Panel("Victoria Park, London")
restgeocode = ESRIRESTServiceGeocode(Addresses=panel_3)  # -> Candidates, Latitude, Longitude
lat = Panel("51.6051967")
# PRO TIP:
# At this point, you can backe the points into the rhino file. That makes the grasshopper definition faster.
# You can add custom properties to each point with Elefont.
long = Panel("-0.1839994")
panel_4 = Panel(restgeocode.Candidates)
branch = TreeBranch(Tree=restgeocode.Candidates, Path="0;0", MaintainPaths=True)
branch_2 = TreeBranch(Tree=restgeocode.Latitude, Path="0;0", MaintainPaths=True)
branch_3 = TreeBranch(Tree=restgeocode.Longitude, Path="0;0", MaintainPaths=True)
panel_5 = Panel(branch)
seteap = SetEarthAnchorPoint(SetEAP=Toggle(True), Latitude=branch_2, Longitude=branch_3)

# ----
# CONVERT COORDINATES
flatten = FlattenTree(Tree=item.Item, Path="{0}")
flatten_2 = FlattenTree(Tree=item.Item1, Path="{0}")
ddtoxy = DecimalDegreesToXY(Latitude=flatten, Longitude=flatten_2)  # -> XyPoint, Transform
# PRO TIP:
# Alternative: You can also backe the geometry into the grasshopper document itself. Create an empty point component, connect it to "cull", right click on the "PT" and choose "internalise data".
panel_6 = Panel(ddtoxy.XyPoint)

geo = Geometry(ddtoxy.XyPoint)

# ----
# Backe with attributes
item_2 = ListItem(List=split, Index="7", Wrap=True)
tstat = TreeStatistics(Tree=item_2)  # -> Paths, Length, Count
dup = DuplicateData(Data="GSR", Number=tstat.Length, Order=True)  # -> simplify(Data)
attributes = DefineObjectAttributes(UserKeys=dup, UserValues=item_2, Layer="Points")
bake = BakeObjects(Geometry=graft(geo), Attributes=attributes, Bake=False)

pt = Point([Point(11110.81585, -6417.06582, 0), Point(11107.78006, -6417.510179, 0), Point(11107.78006, -6417.510179, 0), Point(11102.88139, -6420.065243, 0), Point(11102.88139, -6420.065243, 0), Point(11101.08752, -6420.842871, 0)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])
