# Grasshopper definition 6 Import Shapefiles.gh (Grasshopper 1.0.7)
# plug-ins: Heron, EleFront

# ----
# READ FILE
path = FilePath("C:\Users\vince\Dropbox\UCL RC15 Skills 2024\PervasiveUrbanism_24-25\Skills 1 - Day 3 Datavis\3. Importing Text Files\004RC16S.CSV")
file = ReadFile(File=path, PerLineParse=True)
panel = Panel(file)
cull_i = CullIndex(List=file, Indices="0", Wrap=True)
tab = Panel("\t")
split = TextSplit(Text=cull_i, Separators=tab)
panel_2 = Panel(split)
item = ListItem(List=split, Index="3", Wrap=True)  # -> Item, Item1

flatten = FlattenTree(Tree=item.Item, Path="{0}")  # disabled
flatten_2 = FlattenTree(Tree=item.Item1, Path="{0}")  # disabled
ddtoxy = DecimalDegreesToXY(Latitude=flatten, Longitude=flatten_2)  # -> XyPoint, Transform; disabled
panel_3 = Panel(ddtoxy.XyPoint)  # disabled
panel_4 = Panel("""1551
2191""")  # disabled
cull_i_2 = CullIndex(List=ddtoxy.XyPoint, Indices=panel_4, Wrap=True)  # disabled
panel_5 = Panel("1")  # disabled
points = PointList(Points=cull_i_2, Size=panel_5)  # disabled

lat = Panel("51.547143413134414")
# CONVERT COORDINATES
long = Panel("-0.02326455792985868")
# SET ANCHOR POINT
toggle = BooleanToggle(True)
seteap = SetEarthAnchorPoint(SetEAP=toggle, Latitude=lat, Longitude=long)

geo = Geometry(<curve referenced from the Rhino model>)
path_2 = FilePath("C:\Users\vince\Dropbox\UCL RC15 Skills 2024\PervasiveUrbanism_24-25\Skills 1 - Day 3 Datavis\5. Shapefiles\Road_LAeq_16h_London\Road_LAeq_16h_London.shp")
iv = ImportVector(Boundary=geo, FilePath=path_2, ClipIt=True, PointsOnly=False)  # -> DataExtents, Fields, Values, FeatureGeometry
flatten_3 = FlattenTree(Tree=iv.Values, Path="{0}")
flatten_4 = FlattenTree(Tree=iv.FeatureGeometry, Path="{0}")
panel_6 = Panel(iv.Fields)
python = GhPythonScript(x=flatten_3)  # -> out, items, colors; inputs x: list
# ---------- python: Python ----------
__author__ = "vince"
__version__ = "2024.11.12"

import rhinoscriptsyntax as rs

items = set(x)

colors =[]

for NoiseClass in x:
    if NoiseClass == "65.0-69.9":
        colors.append( "3")
    if NoiseClass == "70.0-74.9":
        colors.append( "4")
    if NoiseClass == "55.0-59.9":
        colors.append( "1")
    if NoiseClass == ">=75.0":
        colors.append( "5")
    if NoiseClass == "60.0-64.9":
        colors.append( "2")
# ---------- end python ----------
noiseclasses = Panel(python.items)
gradient = Gradient(
    LowerLimit="1",
    UpperLimit="5",
    Parameter=python.colors,
    stops=[0: RGB(0, 128, 0), 0.5: RGB(255, 255, 0), 1: RGB(255, 0, 0)])
preview = CustomPreview(Geometry=flatten_4, Material=gradient)

# ---- group: Catalog of ESRI ArcGIS REST Basemaps
esri_arcgis_base_maps = ValueList({"World Imagery": "http://server.arcgisonline.com/ArcGIS/rest/services/World_Imagery/MapServer/export?", "World Topographic": "http://server.arcgisonline.com/ArcGIS/rest/services/World_Topo_Map/MapServer/export?", "World Physical Map": "http://server.arcgisonline.com/ArcGIS/rest/services/World_Physical_Map/MapServer/export?", "World Street Map": "http://server.arcgisonline.com/ArcGIS/rest/services/World_Street_Map/MapServer/export?", "World DeLorme Street Map": "http://server.arcgisonline.com/ArcGIS/rest/services/Specialty/DeLorme_World_Base_Map/MapServer/export?", "World Shaded Relief": "http://server.arcgisonline.com/ArcGIS/rest/services/World_Shaded_Relief/MapServer/export?", "World Terrain Base": "http://server.arcgisonline.com/ArcGIS/rest/services/World_Terrain_Base/MapServer/export?", "World Boundaries and Places": "http://server.arcgisonline.com/ArcGIS/rest/services/Reference/World_Boundaries_and_Places/MapServer/export?", "World Boundaries and Places Alt": "http://server.arcgisonline.com/ArcGIS/rest/services/Reference/World_Boundaries_and_Places_Alternate/MapServer/export?", "World Reference Overlay": "http://server.arcgisonline.com/ArcGIS/rest/services/Reference/World_Reference_Overlay/MapServer/export?", "World Transportation": "http://server.arcgisonline.com/ArcGIS/rest/services/Reference/World_Transportation/MapServer/export?", "World Light Gray Base": "http://server.arcgisonline.com/ArcGIS/rest/services/Canvas/World_Light_Gray_Base/MapServer/export?", "World Light Gray Reference": "http://server.arcgisonline.com/ArcGIS/rest/services/Canvas/World_Light_Gray_Reference/MapServer/export?", "National Geographic World": "http://services.arcgisonline.com/ArcGIS/rest/services/NatGeo_World_Map/MapServer/export?", "USA Topo Maps": "http://server.arcgisonline.com/ArcGIS/rest/services/USA_Topo_Maps/MapServer/export?"}, selected="World Imagery")  # disabled

# ---- group: Not all imagery available at each resolution
resolution = ValueList({"None": , "Low": 256, "Med": 512, "High": 1024, "Max": 2048}, selected="Max")  # disabled

# ---- group: USGS Raster Maps
# IMPORT SHP
usgs = ValueList({"Ortho 1 Foot Imagery": "http://raster.nationalmap.gov/arcgis/rest/services/Orthoimagery/USGS_EROS_Ortho_1Foot/ImageServer/exportImage?", "Ortho Imagery": "http://raster.nationalmap.gov/arcgis/rest/services/Orthoimagery/USGS_EROS_Ortho/ImageServer/exportImage?", "NAIP Imagery": "http://raster.nationalmap.gov/arcgis/rest/services/Orthoimagery/USGS_EROS_Ortho_NAIP/ImageServer/exportImage?", "Land Cover": "http://raster.nationalmap.gov/arcgis/rest/services/LandCover/USGS_EROS_LandCover_NLCD/MapServer/export?", "Land Cover - Conus 01": "http://raster.nationalmap.gov/arcgis/rest/services/LandCover/conus_01/MapServer/export?", "Land Cover - Conus 06": "http://raster.nationalmap.gov/arcgis/rest/services/LandCover/conus_06/MapServer/export?", "Land Cover - Development": "http://raster.nationalmap.gov/arcgis/rest/services/LandCover/Development_0106/MapServer/export?", "Land Cover - Wetland": "http://raster.nationalmap.gov/arcgis/rest/services/LandCover/Wetland_0106/MapServer/export?", "Topo - Scanned Maps": "http://raster.nationalmap.gov/arcgis/rest/services/Scanned_Maps/USGS_EROS_DRG_SCALE/ImageServer/exportImage?"}, selected="Ortho 1 Foot Imagery")  # disabled

# ---- group: Boundary Curve
# DO BACKGROUND IMAGE
geo_2 = Geometry(<curve referenced from the Rhino model>)  # disabled

# ----
image_prefix = Panel("aerial")  # disabled
folder_location_for_images = Panel("C:\Users\vince\Dropbox\UCL RC15 Skills 2024\WIP Folder\Heron\temp")  # disabled
toggle_2 = BooleanToggle(True)  # disabled
restraster = GetRESTRaster(
    Boundary=geo_2,
    Resolution=resolution,
    TargetFolder=folder_location_for_images,
    Prefix=image_prefix,
    RESTURL=esri_arcgis_base_maps,
    ImageType="jpg",
    Run=toggle_2)  # -> Image, ImageFrame, RESTQuery
panel_7 = Panel(esri_arcgis_base_maps)  # disabled

mesh = Mesh(flatten_4)
txt = Text(flatten_3)
col = Colour(gradient)
# BAKE WITH VALUES
panel_8 = Panel(mesh)
panel_9 = Panel(txt)
tstat = TreeStatistics(Tree=txt)  # -> Paths, Length, Count
dup = DuplicateData(Data="NoiseClass", Number=tstat.Length, Order=True)  # -> flatten(Data)
attributes = DefineObjectAttributes(UserKeys=graft(dup), UserValues=graft(panel_9), Name=graft(txt), Layer=graft(txt), Color=graft(col))
bake = BakeObjects(Geometry=graft(mesh), Attributes=attributes, Bake=False)
