# Grasshopper definition Import Point Cloud.gh (Grasshopper 1.0.7)
# plug-ins: Heron

lat = Panel("51.547143413134414")
# IMPORT POINT CLOUD
long = Panel("-0.02326455792985868")
# SET ANCHOR POINT
toggle = BooleanToggle(True)
seteap = SetEarthAnchorPoint(SetEAP=toggle, Latitude=lat, Longitude=long)

# ----
# You can find .laz files of UK on the website of EDINA
path = FilePath("C:\Users\vince\Dropbox\UCL RC15 Skills 2024\PervasiveUrbanism_24-25\Skills 1 - Day 3 Datavis\7. Point Clouds\england-laz-2007_5690259\tq\tq2878_p_4640_20070216_20070216.laz")
importlaz = ImportLAZ(LASLAZPointFile=path)  # -> Info, Points, Colors, PointCloudSRS
pt = Point(flatten(importlaz.Points))
pdecon = Deconstruct(Point=pt)  # -> XComponent, YComponent, ZComponent
bnd = Bounds(Numbers=pdecon.ZComponent)
dedomain = DeconstructDomain(Domain=bnd)  # -> Start, End
gradient = Gradient(
    LowerLimit=dedomain.Start,
    UpperLimit=dedomain.End,
    Parameter=pdecon.ZComponent,
    stops=[0: RGB(234, 38, 0), 0.25: RGB(234, 126, 0), 0.5: RGB(254, 244, 84), 0.75: RGB(173, 203, 249), 1: RGB(75, 107, 169)])
cloud = CloudDisplay(Points=pt, Colours=gradient, Size=1, SpriteType=0)
