# Grasshopper definition Topography.gh (Grasshopper 1.0.7)
# plug-ins: Heron, Human

# ----
# SET ANCHOR POINT
panel = Panel("46.68824925011278, 7.923027392753808")
split = TextSplit(Text=panel, Separators=",")
item = ListItem(List=split, Index=0, Wrap=True)  # -> Item, Item1
seteap = SetEarthAnchorPoint(SetEAP=Toggle(True), Latitude=item.Item, Longitude=item.Item1)

# ----
# GET TOPO IMAGE
panel_2 = Panel("C:\Users\vince\Dropbox\UCL RC15 Skills 2024\PervasiveUrbanism_24-25\Skills 1 - Day 3 Datavis\8. Topography Files\temp")
geo = Geometry(<curve referenced from the Rhino model>)
resttopo = GetRESTTopography(Boundary=geo, TargetFolder=panel_2, Prefix="topo", Run=Toggle(False), TopoSource="SRTM GL1 (30m)")  # -> TopoFile, TopoQuery
importtopo = ImportTopo(Boundary=geo, TopographyRasterFile=resttopo.TopoFile, Clip=True)  # -> TopographyMesh, TopographyExtent, TopographySourceInfo

panel_3 = Panel("C:\Users\vince\Dropbox\UCL RC15 Skills 2024\PervasiveUrbanism_24-25\Skills 1 - Day 3 Datavis\8. Topography Files\temp")

# ----
# USE SAVED TOPO IMAGE (FAST)
geo_2 = Geometry(<curve referenced from the Rhino model>)
path = FilePath("C:\Users\vince\Dropbox\UCL RC15 Skills 2024\PervasiveUrbanism_24-25\Skills 1 - Day 3 Datavis\8. Topography Files\temp\topo_0.tif")
importtopo_2 = ImportTopo(Boundary=geo_2, TopographyRasterFile=path, Clip=True)  # -> TopographyMesh, TopographyExtent, TopographySourceInfo

# ---- group: Boundary Curve
# GET BACKGROUND IMAGE
geo_3 = Geometry(<curve referenced from the Rhino model>)

# ---- group: USGS Raster Maps
usgs = ValueList({"Ortho 1 Foot Imagery": "http://raster.nationalmap.gov/arcgis/rest/services/Orthoimagery/USGS_EROS_Ortho_1Foot/ImageServer/exportImage?", "Ortho Imagery": "http://raster.nationalmap.gov/arcgis/rest/services/Orthoimagery/USGS_EROS_Ortho/ImageServer/exportImage?", "NAIP Imagery": "http://raster.nationalmap.gov/arcgis/rest/services/Orthoimagery/USGS_EROS_Ortho_NAIP/ImageServer/exportImage?", "Land Cover": "http://raster.nationalmap.gov/arcgis/rest/services/LandCover/USGS_EROS_LandCover_NLCD/MapServer/export?", "Land Cover - Conus 01": "http://raster.nationalmap.gov/arcgis/rest/services/LandCover/conus_01/MapServer/export?", "Land Cover - Conus 06": "http://raster.nationalmap.gov/arcgis/rest/services/LandCover/conus_06/MapServer/export?", "Land Cover - Development": "http://raster.nationalmap.gov/arcgis/rest/services/LandCover/Development_0106/MapServer/export?", "Land Cover - Wetland": "http://raster.nationalmap.gov/arcgis/rest/services/LandCover/Wetland_0106/MapServer/export?", "Topo - Scanned Maps": "http://raster.nationalmap.gov/arcgis/rest/services/Scanned_Maps/USGS_EROS_DRG_SCALE/ImageServer/exportImage?"}, selected="Ortho 1 Foot Imagery")

# ---- group: Not all imagery available at each resolution
resolution = ValueList({"None": , "Low": 256, "Med": 512, "High": 1024, "Max": 2048}, selected="Max")

# ---- group: Catalog of ESRI ArcGIS REST Basemaps
esri_arcgis_base_maps = ValueList({"World Imagery": "http://server.arcgisonline.com/ArcGIS/rest/services/World_Imagery/MapServer/export?", "World Topographic": "http://server.arcgisonline.com/ArcGIS/rest/services/World_Topo_Map/MapServer/export?", "World Physical Map": "http://server.arcgisonline.com/ArcGIS/rest/services/World_Physical_Map/MapServer/export?", "World Street Map": "http://server.arcgisonline.com/ArcGIS/rest/services/World_Street_Map/MapServer/export?", "World DeLorme Street Map": "http://server.arcgisonline.com/ArcGIS/rest/services/Specialty/DeLorme_World_Base_Map/MapServer/export?", "World Shaded Relief": "http://server.arcgisonline.com/ArcGIS/rest/services/World_Shaded_Relief/MapServer/export?", "World Terrain Base": "http://server.arcgisonline.com/ArcGIS/rest/services/World_Terrain_Base/MapServer/export?", "World Boundaries and Places": "http://server.arcgisonline.com/ArcGIS/rest/services/Reference/World_Boundaries_and_Places/MapServer/export?", "World Boundaries and Places Alt": "http://server.arcgisonline.com/ArcGIS/rest/services/Reference/World_Boundaries_and_Places_Alternate/MapServer/export?", "World Reference Overlay": "http://server.arcgisonline.com/ArcGIS/rest/services/Reference/World_Reference_Overlay/MapServer/export?", "World Transportation": "http://server.arcgisonline.com/ArcGIS/rest/services/Reference/World_Transportation/MapServer/export?", "World Light Gray Base": "http://server.arcgisonline.com/ArcGIS/rest/services/Canvas/World_Light_Gray_Base/MapServer/export?", "World Light Gray Reference": "http://server.arcgisonline.com/ArcGIS/rest/services/Canvas/World_Light_Gray_Reference/MapServer/export?", "National Geographic World": "http://services.arcgisonline.com/ArcGIS/rest/services/NatGeo_World_Map/MapServer/export?", "USA Topo Maps": "http://server.arcgisonline.com/ArcGIS/rest/services/USA_Topo_Maps/MapServer/export?"}, selected="World Imagery")

# ----
image_prefix = Panel("aerial")
restraster = GetRESTRaster(
    Boundary=geo_3,
    Resolution=resolution,
    TargetFolder=panel_3,
    Prefix=image_prefix,
    RESTURL=esri_arcgis_base_maps,
    ImageType="jpg",
    Run=Toggle(True))  # -> Image, ImageFrame, RESTQuery
panel_4 = Panel(esri_arcgis_base_maps)

# ----
# MAP IMAGE ONTO GEOMETRY
boundary = BoundarySurfaces(Edges=restraster.ImageFrame)
surfacemap = SurfaceMapping(Mesh=importtopo_2.TopographyMesh, Surface=boundary)
previewmat = CustomPreviewMaterials(Geometry=surfacemap, DiffuseColor=RGB(255, 255, 255), DiffuseBitmap=restraster.Image)

# ----
# GET CONTOURS
xy = XYPlane(Origin=Point(0, 0, 0))
contour = Contour(Shape=importtopo_2.TopographyMesh, Point=xy, Direction=Vector(0, 0, 1), Distance=Slider(10, range=0..10))
