# Grasshopper definition Graph.gh (Grasshopper 1.0.7)
# plug-ins: Human

# ---- group: Read File
path = FilePath("C:\Users\vince\Dropbox\UCL RC15 Skills 2024\PervasiveUrbanism_24-25\Skills 1 - Day 3 Datavis\3. Importing Text Files\004RC16S.CSV")
file = ReadFile(File=path, PerLineParse=True)
panel = Panel(file)
cull_i = CullIndex(List=file, Indices="0", Wrap=True)
tab = Panel("\t")
split = TextSplit(Text=cull_i, Separators=tab)
panel_2 = Panel(split)

# ---- group: Graph
# Horizontal Axis
# Python!  ... just a gentle
# alternative...
# Vertical Axis
panel_3 = Panel("7")
item = ListItem(List=split, Index=panel_3, Wrap=True)  # -> flatten(Item)
python = GhPythonScript(x=item)  # -> listlength; inputs x: list
# ---------- python: Python ----------
__author__ = "vince"
__version__ = "2024.12.03"

import rhinoscriptsyntax as rs

listlength = len(x)
# ---------- end python ----------
tstat = TreeStatistics(Tree=item)  # -> Paths, Length, Count
panel_4 = Panel(python)
geo = Geometry(<curve referenced from the Rhino model>)
frames = CurveFrames(Curve=geo, Count=python)  # -> Frames, Parameters
geo_2 = Geometry(<curve referenced from the Rhino model>)
len = Length(Curve=geo_2)
bnd = Bounds(Numbers=flatten(item))
dom = ConstructDomain(DomainStart="0", DomainEnd=len)
remap = RemapNumbers(Value=flatten(item), Source=bnd, Target=dom)  # -> Mapped, Clipped
Y = UnitY(Factor=remap.Mapped)
move = Move(Geometry=frames.Frames, Motion=Y)  # -> Geometry, Transform
pline = PolyLine(Vertices=move.Geometry, Closed=False)

# ---- group: Horizontal Numbers
number_slider = Slider(8, range=0..20)
divide = DivideCurve(Curve=geo_2, Count=number_slider, Kinks=False)  # -> Points, Tangents, Parameters
div = DivideDomain(Domain=dom, Count=number_slider)
dedomain = DeconstructDomain(Domain=div)  # -> Start, End
num = Number("0.00")
ins = InsertItems(List=dedomain.End, Item=num, Indices="0", Wrap=True)
expression = Expression(x=ins, Expression="Round(x,2)")
concat = Concatenate(FragmentA=expression, FragmentB="   ")
tag = TextTag3D(Location=divide.Points, Text=concat, Size=1, Justification=6)

# ---- group: Horizontal Lines
pt = Point(Point(0, 0, 0))
vec2pt = Vector2Pt(PointA=pt, PointB=divide.Points, Unitize=False)  # -> Vector, Length
move_2 = Move(Geometry=geo, Motion=vec2pt.Vector)  # -> Geometry, Transform
cull_i_2 = CullIndex(List=move_2.Geometry, Indices="0", Wrap=True)

# ---- group: Vertical Lines
# get the right values
series = Series(Start="0", Step=Slider(451, range=0..500), Count=python)
smaller = SmallerThan(FirstNumber=series, SecondNumber=python)  # -> SmallerThan, OrEqualTo
# Get horizontal points
cull = CullPattern(List=series, CullPattern=smaller.SmallerThan)
# List with all values
panel_5 = Panel("2")
# select points
item_2 = ListItem(List=frames.Frames, Index=cull, Wrap=True)
item_3 = ListItem(List=split, Index=panel_5, Wrap=True)  # -> flatten(Item)
Y_2 = UnitY(Factor=1)
# draw vertical lines
line = LineSDL(Start=item_2, Direction=Y_2, Length=len)
# List with times
item_4 = ListItem(List=item_3, Index=cull, Wrap=True)
# Text adjustment
# get the right values
panel_6 = Panel("")
concat_2 = Concatenate(FragmentA=panel_6, FragmentB=item_4)
tag_2 = TextTag3D(Location=item_2, Text=concat_2, Size=1, Justification=5)

# ----
button = Button()
createatts = CreateAttributes(LayerName="Graph", enableFullPath=False)
createatts_2 = CreateAttributes(LayerName="Helplines", enableFullPath=False)
merge = Merge(Data1=cull_i_2, Data2=line)
bake = BakeGeometry(Bake=button, Geometry=pline, Attributes=createatts, DeleteOldBakes=False, PreserveTrees=False)
bake_2 = BakeGeometry(Bake=button, Geometry=merge, Attributes=createatts_2, DeleteOldBakes=False, PreserveTrees=False)
