# Grasshopper definition Point Count.gh (Grasshopper 1.0.7)
# plug-ins: Human

# ---- group: Input
geo = Geometry([<point referenced from the Rhino model> x10])
x = Panel("6")
y = Panel("5")

# ---- group: Inclusion
sqgrid = Square(Plane=PlaneXY(0, 0, 0), Size=1, ExtentX=x, ExtentY=y)  # -> flatten(Cells), Points
area = Area(Geometry=sqgrid.Cells)  # -> Area, Centroid
merge = Merge(Data1=geo, Data2=area.Centroid)
pt = Point(merge)
incurves = PointInCurves(Point=pt, Curves=sqgrid.Cells)  # -> Relationship, Index, Point
python = GhPythonScript(numbers=incurves.Index)  # -> out, simplify(a); inputs numbers: list of Int32
# ---------- python: Python ----------
import ghpythonlib.treehelpers as th

index_dict = {}
for index, number in enumerate(numbers):
    if number not in index_dict:
        index_dict[number] = []
    index_dict[number].append(index)

# Ensure all numbers from 0 to max(numbers) are included
max_number = max(numbers)
sorted_index_lists = [index_dict.get(i, []) for i in range(max_number + 1)]

from pprint import pprint
pprint(sorted_index_lists)
pprint(index_dict)





a = th.list_to_tree(sorted_index_lists)
# ---------- end python ----------
tstat = TreeStatistics(Tree=python.a)  # -> Paths, Length, Count

# ---- group: Surface Grid
# Add contrast by "streching" the numbers
bnd = Bounds(Numbers=tstat.Length)
dom = ConstructDomain(DomainStart="0", DomainEnd="4")
remap = RemapNumbers(Value=tstat.Length, Source=bnd, Target=dom)  # -> Mapped, Clipped
Z = UnitZ(Factor=remap.Mapped)
move = Move(Geometry=area.Centroid, Motion=Z)  # -> Geometry, Transform
srfgrid = SurfaceFromPoints(Points=move.Geometry, UCount=x, Interpolate=False)

# ---- group: Graphics & Baking
contour = Contour(Shape=srfgrid, Point=Point(0, 0, 0), Direction=Vector(0, 0, 1), Distance=Slider(0.03, range=0..1))
eval = EvaluateCurve(Curve=contour, Parameter=0)  # -> Point, Tangent, Angle
pdecon = Deconstruct(Point=eval.Point)  # -> XComponent, YComponent, ZComponent
bnd_2 = Bounds(Numbers=flatten(pdecon.ZComponent))
dedomain = DeconstructDomain(Domain=bnd_2)  # -> Start, End
gradient = Gradient(
    LowerLimit=dedomain.Start,
    UpperLimit=dedomain.End,
    Parameter=flatten(pdecon.ZComponent),
    stops=[0: RGB(234, 38, 0), 0.25: RGB(234, 126, 0), 0.5: RGB(254, 244, 84), 0.75: RGB(173, 203, 249), 1: RGB(75, 107, 169)])
preview = CustomPreview(Geometry=flatten(contour), Material=gradient)
createatts = CreateAttributes(LayerName="Contours", Color=gradient, enableFullPath=False)
bake = BakeGeometry(Bake=Button(), Geometry=flatten(contour), Attributes=createatts, DeleteOldBakes=False, PreserveTrees=False)
