# Grasshopper definition 2 Culebra Paths.gh (Grasshopper 1.0.7)
# plug-ins: Culebra_GH

geometry = Geometry([<curve referenced from the Rhino model> x285])
multi_path_tracking = MultiPathTracking(
    Polylines=geometry,
    PolylineThreshold=Slider(275.93, range=0..1000),
    ProjectionDistance=Slider(6.52, range=0..100),
    PolylineRadius=Slider(2, range=0..50))
value_list = ValueList({"Type A - 2D & 3D": 0, "Type B - 3D": 1, "Type C - 3D": 2}, selected="Type A - 2D & 3D")
# COLOR AT END
colour_swatch = ColourSwatch(SwatchColor=RGB(92, 158, 173))
# COLOR AT START
colour_swatch_2 = ColourSwatch(SwatchColor=RGB(5, 74, 145))
panel = Panel("5")
panel_2 = Panel("""50
200
50
100""")
controller = Controller(MultiPathTracking=multi_path_tracking)
geometry_2 = Geometry([<curve referenced from the Rhino model> x4])
split_argb = SplitARGB(Colour=colour_swatch, IntegerChannels=True)  # -> Alpha, Red, Green, Blue
split_argb_2 = SplitARGB(Colour=colour_swatch_2, IntegerChannels=True)  # -> Alpha, Red, Green, Blue
weaving_wandering = WeavingWandering(
    Change=Slider(100, range=0..100),
    Radius=Slider(5, range=0..1000),
    Distance=Slider(14.03, range=0..200),
    RotationTrigger=Slider(10.12, range=0..100),
    Type=value_list)
wandering = Wandering(
    Randomize=Toggle(True),
    AddHeading=Toggle(True),
    Change=Slider(100, range=0..100),
    Radius=Slider(20, range=0..100),
    Distance=Slider(81, range=0..100))
populate_2d = Populate2D(Region=geometry_2, Count=panel_2, Seed=1)  # -> flatten(Population)
unit_x = UnitX(Factor=1)
geometry_3 = Geometry(<point referenced from the Rhino model>)
# RED
construct_domain = ConstructDomain(DomainStart=split_argb.Red, DomainEnd=split_argb_2.Red)
# GREEN
construct_domain_2 = ConstructDomain(DomainStart=split_argb.Green, DomainEnd=split_argb_2.Green)
# BLUE
construct_domain_3 = ConstructDomain(DomainStart=split_argb.Blue, DomainEnd=split_argb_2.Blue)
geometry_4 = Geometry(<curve referenced from the Rhino model>)
initial_move = Slider(0.5, range=0..10)
max_speed = Slider(2, range=0..10)
force = Slider(0.86, range=0..10)
n_a_for_wandering = Slider(0, range=0..10)
attract_behavior = Attract_Behavior(
    Targets=geometry_3,
    Thresholds=Slider(50, range=0..100),
    AttractionValue=Slider(3.21, range=0..10),
    MaxAttraction=Slider(0.06, range=0..1))  # -> AttractionForce, AttractionThresholdViz
point_spawn = PointSpawn(Points=populate_2d, Box=geometry_4)
controller_2 = Controller(Multi_Path_Tracking=multi_path_tracking, Wandering=wandering)
unit_x_2 = UnitX(Factor=".1")
dimension = ValueList({"2D": 0, "3D": 1}, selected="3D")
bounds = ValueList({"Bounce": 0, "Respawn": 1, "None": 2}, selected="Respawn")
controller_3 = Controller(Wandering=wandering)
controller_4 = Controller(WeavingWandering=weaving_wandering)
move_settings = MoveSettings(InitialSpeedVector=initial_move, MaxSpeed=max_speed, MaxForce=force, VelocityMultiplier=n_a_for_wandering)
init_settings = InitSettings(SpawnSettings=point_spawn, Dimension=dimension, Boundary=bounds)
gradient_color = Gradient_Color(
    AlphaChannel=Slider(250, range=0..255),
    RedChannel=construct_domain,
    GreenChannel=construct_domain_2,
    BlueChannel=construct_domain_3,
    MinimumThickness=Slider(1, range=0..1),
    MaximumThickness=Slider(2, range=0..10))
trail_data = TrailData(Trail=Toggle(True), TrailStep=Slider(1, range=0..10), MaxTrailSize=Slider(772, range=0..1000))
value_list_2 = ValueList({"Graphic": 0, "Geometry": 1}, selected="Graphic")
trigger = Trigger(Interval=100, TimerInterval=100, Target=creeper_engine)
visual_settings = VisualSettings(TrailData=trail_data, ColorData=gradient_color, ApplyTexture=Toggle(False), DisplayMode=value_list_2)
creeper_engine = Creeper_Engine(
    InitSettings=init_settings,
    MoveSettings=move_settings,
    BehavioralSettings=controller_2,
    VisualSettings=visual_settings,
    Reset=Button())  # -> Creepers, Trails, Connectivity
dot_display = DotDisplay(Point=creeper_engine.Creepers, Colour=ColourSwatch(SwatchColor=RGB(115, 44, 44)), Size="2")
